# Grasshopper definition add.gh (Grasshopper 1.0.8)

a = GetInteger(Slider(2, range=2..10), {"0": 5}, selected=[], AtLeast=1, AtMost=1, Maximum=2147483647, Minimum=5, TreeAccess=False)
b = GetInteger(AtLeast=1, AtMost=1, Maximum=2147483647, Minimum=-2147483648, TreeAccess=False)
addition = Addition(A=a, B=b)
context_print = ContextPrint(Text=addition)
